# Grasshopper definition Chair_v5.gh (Grasshopper 1.0.7)
# plug-ins: Pufferfish, Kangaroo2 Components

curve = Curve(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)
curve_2 = Curve(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)
curve_3 = Curve(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)
area = Area(Geometry=curve_2)  # -> Area, Centroid
area_2 = Area(Geometry=curve_3)  # -> Area, Centroid
right_rail = GetNumber(Slider(1, range=0.5..1.5), AtLeast=1, AtMost=1, Maximum=1.797693135e+308, Minimum=-1.797693135e+308)
left_rail = GetNumber(Slider(1.5, range=0.5..1.5), AtLeast=1, AtMost=1, Maximum=1.797693135e+308, Minimum=-1.797693135e+308)
# BM  //  COMPLEX FORMING
# 19 Nov - Meshes
inputs = Data("INPUTS")
scale = Scale(Geometry=curve_2, Center=area.Centroid, Factor=right_rail)  # -> Geometry, Transform
scale_2 = Scale(Geometry=curve_3, Center=area_2.Centroid, Factor=left_rail)  # -> Geometry, Transform
process = Data("PROCESS")
outputs = Data("OUTPUTS")
merge = Merge(Data1=scale_2.Geometry, Data2=curve, Data3=scale.Geometry)  # -> flatten(Result)
crv = Curve(merge)
series = Series(Start="-200", Step=Slider(0.7, range=0..10), Count=Slider(1500, range=100..2000))
range = Range(Domain=Domain(0, 1), Steps=Slider(20, range=1..300))
loft = Loft(Curves=crv, Options={Adjust=False, Closed=False, LoftEnds=0, LoftSimp=0, LoftType=0, Rebuild=10, Refit=0.01})
construct_point = ConstructPoint(XCoordinate=series, YCoordinate=Slider(-180, range=-500..500), ZCoordinate=Slider(173, range=0..1000))
unit_y = UnitY(Factor=Slider(247, range=0..1000))
twnconcrvs = TweenConsecutiveCurves(Curves=crv, Factor=range, Loopback=False, InterpolationType=Slider(3, range=0..3), Refit=0, PointSample=0)  # -> simplify(graft(Tween))
move = Move(Geometry=construct_point, Motion=unit_y)  # -> Geometry, Transform
panel = Panel(twnconcrvs)
line = Line(StartPoint=construct_point, EndPoint=move.Geometry)
offset = OffsetCurve(Curve=twnconcrvs, Distance="-2", Corners=1)  # -> simplify(Curve)
merge_2 = Merge(Data1=twnconcrvs, Data2=offset)
curve_4 = Curve(line)
project = Project(Curve=curve_4, Brep=loft, Direction=Vector(0, 0, 1))
loft_2 = Loft(Curves=merge_2, Options={Adjust=False, Closed=False, LoftEnds=0, LoftSimp=0, LoftType=0, Rebuild=10, Refit=0.01})
# VERSION 01  //  2021.11.19
offset_surface = OffsetSurface(Surface=loft_2, Distance=1, BothSides=0, CreateSolid=True)
multipipe = MultiPipe(Curves=project, NodeSize=Slider(0.1, range=0..1), EndOffset=1, StrutSize=1, Segment=0, KinkAngle=0.6, CubeFit=0, Caps=0)
mesh_brep = MeshBrep(
    Brep=offset_surface,
    Settings={GridMaxCount=0, GridMinCount=16, JaggedSeams=False, MaxEdgeLength=0, MinEdgeLength=0.0001, MinTolerance=0, Refine=True, RefineAngle=0, RelativeTolerance=0.65, SimplePlanes=True, Tolerance=0})
subd = SubD(multipipe)

# ---- group: RH_OUT:Mesh
mesh = Mesh(flatten(mesh_brep))

# ----
custom_preview = CustomPreview(
    Geometry=subd,
    Material={diffuse=RGB(221, 160, 221), emission=RGB(66, 48, 66), shine=0.5, specular=RGB(255, 255, 255), transparency=0})  # disabled
