# Grasshopper definition test2.gh (Grasshopper 1.0.7)
# plug-ins: Heteroptera

# BM  //  COMPLEX FORMING
# 19 Nov - Meshes
inputs = Data("INPUTS")
process = Data("PROCESS")
curve = Curve(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)
planes_amount = Slider(79, range=0..1000)
curve_min = Slider(38.97, range=0..100)
curve_max = Slider(68.11, range=0..100)
mesh_pipe_radius = Slider(0.459, range=0.001..5)
outputs = Data("OUTPUTS")
max = GetNumber(curve_max, AtLeast=1, AtMost=1, Maximum=1.797693135e+308, Minimum=-1.797693135e+308)
min = GetNumber(curve_min, AtLeast=1, AtMost=1, Maximum=1.797693135e+308, Minimum=-1.797693135e+308)

range = Range(Domain=Domain(0, 1), Steps=planes_amount)
graph_mapper = GraphMapper(
    range,
    x0=0,
    x1=1,
    y0=0,
    y1=1,
    container_name="Sine",
    Equation_px=[0.06405335665, 0.1115023866],
    Equation_py=[0.2064040899, 0.8214566708])
remap = Remap(data=graph_mapper, min=min, max=max)

lenght = Data(remap)

perp_frames = PerpFrames(Curve=curve, Count=planes_amount, Align=True)  # -> Frames, Parameters
deconstruct_plane = DeconstructPlane(Plane=perp_frames.Frames)  # -> Origin, XAxis, YAxis, ZAxis
# VERSION 01  //  2021.11.19
line_sdl = LineSDL(Start=perp_frames.Frames, Direction=deconstruct_plane.Origin, Length=lenght)

plane = Plane(perp_frames.Frames)
pipe = Pipe(Curve=line_sdl, Radius=mesh_pipe_radius, Caps=0)

# ---- group: GRADIENT OPTION 02
volume = Volume(Geometry=flatten(pipe))  # -> Volume, Centroid
min_max = MinMax(Number=volume.Volume)  # -> Minimum, Maximum
gradient = Gradient(
    LowerLimit=min_max.Minimum,
    UpperLimit=min_max.Maximum,
    Parameter=volume.Volume,
    stops=[0: RGB(18, 75, 88), 0.463: RGB(255, 192, 192), 1: RGB(220, 0, 40)])

# ---- group: RH_OUT:Mesh
mesh = Mesh(flatten(pipe))

# ----
medges = MeshEdges()  # -> NakedEdges, InteriorEdges, NonManifoldEdges
join = JoinCurves(Curves=medges.NakedEdges, Preserve=False)
join_2 = JoinCurves(Curves=medges.InteriorEdges, Preserve=False)
merge = Merge(Data1=join, Data2=join_2)  # -> flatten(Result)
c_script = CSharpScript(crv=merge)  # -> out, A; inputs crv: Curve, color: Color
# ---------- c_script: C# ----------
    var c = color.R + "," + color.G + "," + color.B;
    crv.SetUserString("color", c);
    A = crv;
# ---------- end c_script ----------
custom_preview = CustomPreview(Geometry=flatten(pipe), Material=gradient)

# ---- group: RH_OUT:edges
curve_2 = Curve(flatten(c_script.A))

# ==== cluster Remap: Remaps numbers
data = ClusterInput()
min = ClusterInput()
max = ClusterInput()
bnd = Bounds(Numbers=data)
dom = ConstructDomain(DomainStart=min, DomainEnd=max)
remap = RemapNumbers(Value=data, Source=bnd, Target=dom)  # -> Mapped, Clipped
R = ClusterOutput(remap.Mapped)
